# Grasshopper definition 2.brep_environment.gh (Grasshopper 0.9.76)
# plug-ins: Physarealm

brep = Brep(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)
point = Point([Point(402, 355, 61), Point(493, 373, 61)])
point_2 = Point([Point(493, 373, 61), Point(402, 355, 61), Point(402, 355, 195), Point(467, 413, 195), Point(493, 191, 61), Point(438, 445, 61)])
brep_environment = BrepEnvironment(XResolution=100, YResolution=100, ZResolution=100, Brep=brep)
point_emitter = PointEmitter(Points=point)
points_food = PointsFood(Points=point_2)
timer = Timer(TimerInterval=100, Target=physarealm)  # disabled
physarealm = Physarealm(Environment=brep_environment, Emitter=point_emitter, Food=points_food, Reset=Toggle(True))  # -> ChemoAttractorField, Population, Iteration
population_position = PopulationPosition(Population=physarealm.Population)
