# Grasshopper definition 4.surface_environment.gh (Grasshopper 0.9.76)
# plug-ins: Physarealm

number_slider = Slider(300, range=0..1000)
surface = Surface(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)
point = Point([Point(520.9178259, 558.2739919, 54.12133256), Point(649.4559907, 598.8649913, 54.12133256)])
point_2 = Point([Point(446.5009936, 686.8121567, 54.12133256), Point(622.3953245, 707.1076564, 54.12133256), Point(649.4559907, 598.8649913, 54.12133256), Point(520.9178259, 558.2739919, 54.12133256), Point(432.9706605, 429.7358271, 54.12133256), Point(608.8649913, 355.3189948, 54.12133256), Point(744.1683227, 368.8493279, 54.12133256)])
surface_environment = SurfaceEnvironment(UResolution=number_slider, VResolution=number_slider, Surface=surface)
point_emitter = PointEmitter(Points=point)
points_food = PointsFood(Points=point_2)

death_distance_setting = DeathDistanceSetting(DeathDistance=Slider(10, range=0..10))
birth_death_setting = BirthDeathSetting(
    DivisionDetectRadius=2,
    DivisionMin=0,
    DivisionMax="1",
    DeathDetectRadius=Slider(1, range=0..1),
    DeathMin=0,
    DeathMax=Slider(25, range=0..100))
sensor_setting = SensorSetting(SensorAngle=22.5, RotateAngle=45, SensorOffset=7)
speed_setting = SpeedSetting(MaxSpeed=Slider(3, range=0..10))

timer = Timer(TimerInterval=20, Target=physarealm)  # disabled
physarealm = Physarealm(
    Environment=surface_environment,
    Emitter=point_emitter,
    Food=points_food,
    Settings=[birth_death_setting, speed_setting, sensor_setting, death_distance_setting],
    Reset=Toggle(True))  # -> ChemoAttractorField, Population, Iteration
population_position = PopulationPosition(Population=physarealm.Population)
