# Grasshopper definition 2.brep_environment.gh (Grasshopper 0.9.76)
# plug-ins: Physarealm

brep = Brep(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)
point = Point([Point(69, 23, 87), Point(70, 79, 87)])
point_2 = Point([Point(69, 23, 87), Point(70, 79, 87), Point(23, 25, 15), Point(29, 67, 15), Point(77, 37, 15)])
brep_environment = BrepEnvironment(XResolution=100, YResolution=100, ZResolution=100, Brep=brep)
point_emitter = PointEmitter(Points=point)
points_food = PointsFood(Points=point_2)
timer = Timer(TimerInterval=100, Target=physarealm)  # disabled
physarealm = Physarealm(Environment=brep_environment, Emitter=point_emitter, Food=points_food, Reset=Toggle(False))  # -> ChemoAttractorField, Population, Iteration
population_position = PopulationPosition(Population=physarealm.Population)
