# Grasshopper definition 3. velocities.gh (Grasshopper 0.9.76)
# plug-ins: Physarealm

box = Box({Plane=Plane(origin=(0, 0, 0), x=(0, 0, 1), y=(1, 0, 0)), X=Domain(0, 100), Y=Domain(0, 100), Z=Domain(0, 100)})
point = Point([Point(69, 23, 87), Point(70, 79, 87)])
point_2 = Point([Point(69, 23, 87), Point(70, 79, 87), Point(23, 25, 15), Point(29, 67, 15), Point(77, 37, 15)])
box_environment = BoxEnvironment(XResolution=100, YResolution=100, ZResolution=100, Box=box)
point_emitter = PointEmitter(Points=point)
points_food = PointsFood(Points=point_2)
timer = Timer(TimerInterval=100, Target=physarealm)  # disabled
physarealm = Physarealm(Environment=box_environment, Emitter=point_emitter, Food=points_food, Reset=Toggle(False))  # -> ChemoAttractorField, Population, Iteration
population_velocity = PopulationVelocity(Population=physarealm.Population)
population_locations = PopulationLocations(Population=physarealm.Population)
vector_display = VectorDisplay(Anchor=population_locations, Vector=population_velocity)
