# Grasshopper definition 5. field_interconnect_with_millipede_optimization.gh (Grasshopper 0.9.76)
# plug-ins: SpiderWeb :: Graph Tools, Physarealm, Millipede

number_slider = Slider(50, range=0..100)
box = Box({Plane=Plane(origin=(0, 0, 0), x=(0, 0, 1), y=(1, 0, 0)), X=Domain(0, 100), Y=Domain(0, 100), Z=Domain(0, 100)})
point = Point([Point(69, 23, 87), Point(70, 79, 87)])
point_2 = Point([Point(69, 23, 87), Point(70, 79, 87), Point(23, 25, 15), Point(29, 67, 15), Point(77, 37, 15)])
set_difference = SetDifference(SetA=point_2, SetB=point)
box_environment = BoxEnvironment(XResolution=number_slider, YResolution=number_slider, ZResolution=number_slider, Box=box)
point_emitter = PointEmitter(Points=point)
points_food = PointsFood(Points=point_2)
timer = Timer(TimerInterval=100, Target=physarealm)  # disabled
number_slider_2 = Slider(10, range=0..10)
number_slider_3 = Slider(5, range=0..10)
number_slider_4 = Slider(10, range=0..10)
physarealm = Physarealm(Environment=box_environment, Emitter=point_emitter, Food=points_food, Reset=Toggle(False))  # -> ChemoAttractorField, Population, Iteration
center_box = CenterBox(Base=point, X=number_slider_4, Y=number_slider_4, Z=number_slider_3)
center_box_2 = CenterBox(Base=set_difference, X=number_slider_2, Y=number_slider_2, Z=number_slider_3)
brep = Brep(center_box_2)
brep_2 = Brep(center_box)
vector_xyz = VectorXYZ(XComponent=0, YComponent=0, ZComponent="-50000")  # -> Vector, Length
brep_3 = Brep(box)
field_value = FieldValue(Field=physarealm.ChemoAttractorField)
_3d_support_region = _3DSupportRegion(Boundary=brep, SupportType=63, AmendExistingSupports=True)
_3d_boundary_region = _3DBoundaryRegion(Boundary=brep_3, IsVoid=False)
_3d_load_region = _3DLoadRegion(Boundary=brep_2, Load=vector_xyz.Vector)
bounds = Bounds(Numbers=field_value)
topostruct_3d_model = Topostruct3DModel(ModelComponents=[_3d_boundary_region, _3d_load_region, _3d_support_region], XResolution=12)  # -> FEModel, CellCentres, CellSize
remap_numbers = RemapNumbers(Value=field_value, Source=bounds, Target=Domain(0, 1))  # -> Mapped, Clipped
topostruct_3d_solver = Topostruct3DSolver(
    FEModel=topostruct_3d_model.FEModel,
    SelfWeightCoefficient=0,
    OptimisationIterations=1,
    Smoothing=0.1,
    Penalization=3,
    TargetDensity=0.6,
    InitialDensities=remap_numbers.Mapped,
    MinimumDensity=0.001,
    DeleteThreshold=0.5,
    PeriodicX=False,
    PeriodicY=False,
    PeriodicZ=False,
    LoadCase=0,
    AllCases=True)  # -> FEModel, MaxDeflection; disabled
_3d_cell_results = _3DCellResults(FEModel=topostruct_3d_solver.FEModel)  # -> PrincipalStressPlanes, PrincipalStresses, VonMisesStress, Density
c_script = CSharpScript(x=number_slider, nums=_3d_cell_results.Density, pts=topostruct_3d_model.CellCentres)  # -> out, lines, weights; inputs x: Int32, nums: list of Double, pts: list of Point3d
# ---------- c_script: C# ----------
    int count = 0;
    List<Line> retLine = new List<Line>();
    List<double> weight = new List<double>();
    for(int k = 0; k < x; k++){
      for(int j = 0; j < x; j++)
      {
        for(int i = 0; i < x; i++){
          param[i, j, k] = nums[count];
          count++;
        }
      }
    }

    for(int k = 0; k < x; k++){
      for(int j = 0; j < x; j++)
      {
        for(int i = 0; i < x; i++){
          if(rd.NextDouble() > param[i, j, k] )
            continue;
          Point3d thispt = new Point3d(i, j, k);
          List<Point3d> neighbor = findNeighborParticle(i, j, k, 1, 0.0001);
          foreach(Point3d pt in neighbor){
            if(rd.NextDouble() < param[i, j, k] * 2){
              retLine.Add(new Line(pt, thispt));
              weight.Add(param[i, j, k] + param[(int) pt.X, (int) pt.Y, (int) pt.Z]);
            }
          }
        }
      }
    }
    lines = retLine;
    weights = weight;
# ---------- c_script: C# additional code ----------
  double[,,] param = new double[50, 50, 50];
  int _x = 50;
  int _y = 50;
  int _z = 50;
  Random rd = new Random();

  public List<Point3d> findNeighborParticle(int x, int y, int z, int radius, double near_level)
  {
    List<Point3d> nei = new List<Point3d>();
    int start_x = x - radius > 0 ? x - radius : 0;
    int start_y = y - radius > 0 ? y - radius : 0;
    int start_z = z - radius > 0 ? z - radius : 0;
    int end_x = x + radius <= _x - 1 ? x + radius : _x - 1;
    int end_y = y + radius <= _y - 1 ? y + radius : _y - 1;
    int end_z = z + radius <= _z - 1 ? z + radius : _z - 1;
    for (int i = start_x; i <= end_x; i++)
    {
      for (int j = start_y; j <= end_y; j++)
      {
        for (int k = start_z; k <= end_z; k++)
        {
          if (param[i, j, k] - param[x, y, z] < near_level)
            nei.Add(new Point3d(i, j, k));
        }
      }
    }

    return nei;
  }
# ---------- end c_script ----------
scale = Scale(Geometry=c_script.lines, Center=Point(0, 0, 0), Factor=2)  # -> Geometry, Transform
graphfromlines = GraphFromLines(ConnectionLines=scale.Geometry, undirected=True)  # -> Graph, GraphPoints

# ---- group: slide to find a web with most lines
breadth_first_search = BreadthFirstSearch(Graph=graphfromlines.Graph, StartPoints=Slider(957, range=0..1000), methode=0)  # -> PreviouseGraph, Cost

# ----
display_graph = DisplayGraph(Graph=breadth_first_search.PreviouseGraph, GraphPoints=graphfromlines.GraphPoints, hidden=True)  # -> VertexCount, EdgeCount, Edge
line = Line(display_graph.Edge)

# ---- group: remap edge with weight
c_script_2 = CSharpScript(lines=line, weights=_3d_cell_results.Density)  # -> out, A; inputs lines: list of Line, weights: list of Double
# ---------- c_script_2: C# ----------
    int count = 0;
    List<double> weis = new List<Double>();
    for(int k = 0; k < 50; k++){
      for(int j = 0; j < 50; j++)
      {
        for(int i = 0; i < 50; i++){
          param[i, j, k] = weights[count];
          count++;
        }
      }
    }
    foreach(Line l in lines)
    {
      Point3d midpt = l.PointAt(0.5);
      double val = param[(int)midpt.X / 2, (int)midpt.Y / 2,(int) midpt.Z / 2];
      weis.Add(val);
    }
    A = weis;
# ---------- c_script_2: C# additional code ----------
  double[,,] param = new double[50, 50, 50];
# ---------- end c_script_2 ----------

# ----
graph_mapper = GraphMapper(c_script_2.A, x0=0, x1=1, y0=0, y1=1, container_name="Conic", Cx=0.3333333433, Cy=0.7565214634)
gradient = Gradient(LowerLimit=1, UpperLimit=0, Parameter=graph_mapper, stops=[0: RGB(255, 255, 255), 1: RGB(0, 0, 0)])
custom_preview = CustomPreview(Geometry=line, Shader=gradient)
