# Grasshopper definition 5.population_trail.gh (Grasshopper 0.9.76)
# plug-ins: Physarealm

box = Box({Plane=Plane(origin=(0, 0, 0), x=(0, 0, 1), y=(1, 0, 0)), X=Domain(0, 100), Y=Domain(0, 100), Z=Domain(0, 100)})
point = Point([Point(69, 23, 87), Point(70, 79, 87)])
point_2 = Point([Point(69, 23, 87), Point(70, 79, 87), Point(23, 25, 15), Point(29, 67, 15), Point(77, 37, 15)])
box_environment = BoxEnvironment(XResolution=100, YResolution=100, ZResolution=100, Box=box)
point_emitter = PointEmitter(Points=point)
points_food = PointsFood(Points=point_2)
timer = Timer(TimerInterval=100, Target=physarealm)  # disabled
physarealm = Physarealm(Environment=box_environment, Emitter=point_emitter, Food=points_food, Reset=Toggle(False))  # -> ChemoAttractorField, Population, Iteration
population_position = PopulationPosition(Population=physarealm.Population)
population_trail = PopulationTrail(Population=physarealm.Population, HistoryStep=10, Reset=Toggle(False))
nurbs_curve = NurbsCurve(Vertices=population_trail, Degree=3, Periodic=False)  # -> Curve, Length, Domain
polyline = PolyLine(Vertices=population_trail, Closed=False)
explode = Explode(Curve=polyline, Recursive=True)  # -> Segments, Vertices
list_length = ListLength(List=explode.Segments)
divide_curve = DivideCurve(Curve=nurbs_curve.Curve, Count=list_length, Kinks=False)  # -> Points, Tangents, Parameters
shatter = Shatter(Curve=nurbs_curve.Curve, Parameters=divide_curve.Parameters)
list_length_2 = ListLength(List=explode.Segments)
list_length_3 = ListLength(List=flatten(explode.Segments))
series = Series(Start=0, Step=1, Count=list_length_2)
panel = Panel(list_length_3)
bounds = Bounds(Numbers=flatten(series))
deconstruct_domain = DeconstructDomain(Domain=bounds)  # -> Start, End
gradient = Gradient(
    LowerLimit=deconstruct_domain.Start,
    UpperLimit=deconstruct_domain.End,
    Parameter=series,
    stops=[0: RGB(255, 255, 255), 1: RGB(0, 0, 0)])
custom_preview = CustomPreview(Geometry=shatter, Shader=reverse(gradient))
