# Grasshopper definition surface_environment_test.gh (Grasshopper 0.9.76)
# plug-ins: Physarealm

number_slider = Slider(150, range=0..1000)
point = Point(Point(296, 166, 44))
point_2 = Point([Point(246, 96, 0), Point(296, 166, 44)])
surface = Surface(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)
birth_death_setting = BirthDeathSetting(
    DivisionDetectRadius=Slider(4, range=0..10),
    DivisionMin=0,
    DivisionMax=Slider(10, range=0..100),
    DeathDetectRadius=Slider(2, range=0..10),
    DeathMin=0,
    DeathMax=Slider(25, range=0..100))
points_food = PointsFood(Points=point_2)
point_emitter = PointEmitter(Points=point)
surface_environment = SurfaceEnvironment(UResolution=number_slider, VResolution=number_slider, Surface=surface)
timer = Timer(TimerInterval=100, Target=physarealm)  # disabled
physarealm = Physarealm(
    Environment=surface_environment,
    Emitter=point_emitter,
    Food=points_food,
    Settings=birth_death_setting,
    Reset=Toggle(True))  # -> ChemoAttractorField, Population, Iteration
population_velocity = PopulationVelocity(Population=physarealm.Population)
population_position = PopulationPosition(Population=physarealm.Population)
vector_display_ex = VectorDisplayEx(Point=population_position, Vector=population_velocity, Colour=RGB(0, 0, 0), Width=2)
