# Grasshopper definition test.gh (Grasshopper 0.9.76)
# plug-ins: Exoskeleton2, Physarealm, Kangaroo Components

detect_direction_setting = DetectDirectionSetting(DetectDirection=4)
point = Point([<point referenced from the Rhino model> x2])
point_2 = Point([<point referenced from the Rhino model> x3])
box = Box({Plane=Plane(origin=(0, 0, 0), x=(0, 1, 0), y=(1, 0, 0)), X=Domain(0, 100), Y=Domain(0, 100), Z=Domain(-100, 0)})
death_distance_setting = DeathDistanceSetting(DeathDistance=Slider(56, range=0..100))
point_emitter = PointEmitter(Points=point)
trail_setting = TrailSetting(AgentFoodTrailRatio=Slider(0.5, range=0..1))
points_food = PointsFood(Points=point_2)
birth_death_setting = BirthDeathSetting(
    DivisionDetectRadius=Slider(3, range=0..10),
    DivisionMin=0,
    DivisionMax=10,
    DeathDetectRadius=Slider(2, range=0..10),
    DeathMin=0,
    DeathMax=123)
box_environment = BoxEnvironment(XResolution=100, YResolution=100, ZResolution=100, Box=box)
guide_setting = GuideSetting(VerticalGuideFactor=Slider(0.11, range=0..1))
initial_population_setting = InitialPopulationSetting(PopulationSize=200)
speed_setting = SpeedSetting(MaxSpeed=Slider(2, range=0..10))
sensor_setting = SensorSetting(SensorAngle=22.5, RotateAngle=45, SensorOffset=Slider(7, range=0..10))
physarealm = Physarealm(
    Environment=box_environment,
    Emitter=point_emitter,
    Food=points_food,
    Settings=[initial_population_setting, guide_setting, sensor_setting, speed_setting, birth_death_setting, trail_setting, death_distance_setting, detect_direction_setting],
    Reset=Toggle(False))  # -> ChemoAttractorField, Population, Iteration
timer = Timer(TimerInterval=200, Target=physarealm)  # disabled
population_position = PopulationPosition(Population=physarealm.Population)
panel = Panel(physarealm.Iteration)
panel_2 = Panel(physarealm.Population)
population_trail = PopulationTrail(Population=physarealm.Population, HistoryStep=10, Reset=Toggle(False))
removeduplicatepts = RemoveDuplicatePts(Points=population_trail, Tolerance=0.01)
polyline = PolyLine(Vertices=removeduplicatepts, Closed=False)
explode = Explode(Curve=polyline, Recursive=True)  # -> Segments, Vertices
explode_2 = Explode(Curve=flatten(polyline), Recursive=True)  # -> flatten(Segments), Vertices
interpolate = Interpolate(Vertices=removeduplicatepts, Degree=3, Periodic=False, KnotStyle=1)  # -> Curve, Length, Domain
list_length = ListLength(List=explode.Segments)
number_slider = Slider(0.5, range=0..1)
series = Series(Start=0, Step=1, Count=list_length)
bounds = Bounds(Numbers=flatten(series))
exowireframe = ExoWireframe(
    Lines=explode_2.Segments,
    Sides=6,
    StartRadius=number_slider,
    EndRadius=number_slider,
    NodeDepth=0,
    Division=Slider(20, range=0..100),
    Open=False)
deconstruct_domain = DeconstructDomain(Domain=bounds)  # -> Start, End
gradient = Gradient(
    LowerLimit=deconstruct_domain.Start,
    UpperLimit=deconstruct_domain.End,
    Parameter=series,
    stops=[0: RGB(255, 255, 255), 1: RGB(0, 0, 0)])
custom_preview = CustomPreview(Geometry=explode.Segments, Shader=gradient)
