# Grasshopper definition testBrepEnvi.gh (Grasshopper 0.9.76)
# plug-ins: MeshEdit Components, Python Interpreter, SpiderWeb :: Graph Tools, Physarealm, Millipede

number_slider = Slider(50, range=0..100)
point = Point([<point referenced from the Rhino model> x2])
point_2 = Point([<point referenced from the Rhino model> x5])
brep = Brep(<brep referenced from the Rhino model>)
brep_2 = Brep(<brep referenced from the Rhino model>)
cloud_display = CloudDisplay(Points=point_2, Colours=ColourSwatch(SwatchColor=RGBA(255, 0, 0, 145)), Size=2, SpriteType=0)
trail_setting = TrailSetting(AgentFoodTrailRatio=Slider(0.5, range=0..1))
number_slider_2 = Slider(10, range=0..10)
number_slider_3 = Slider(5, range=0..10)
number_slider_4 = Slider(10, range=0..10)
initial_population_setting = InitialPopulationSetting(PopulationSize=200)
brep_environment = BrepEnvironment(XResolution=number_slider, YResolution=number_slider, ZResolution=number_slider, Brep=brep)  # -> Environment, Pts
point_emitter = PointEmitter(Points=point)
points_food = PointsFood(Points=point_2)
timer = Timer(TimerInterval=50, Target=physarealm)  # disabled
point_3 = Point([<point referenced from the Rhino model> x3])
center_box = CenterBox(Base=point, X=number_slider_4, Y=number_slider_4, Z=number_slider_3)
center_box_2 = CenterBox(Base=point_3, X=number_slider_2, Y=number_slider_2, Z=number_slider_3)
physarealm = Physarealm(
    Environment=brep_environment.Environment,
    Emitter=point_emitter,
    Food=points_food,
    Settings=[initial_population_setting, trail_setting],
    Reset=Toggle(False))  # -> ChemoAttractorField, Population, Iteration
number_slider_5 = Slider(2, range=0..10)
number_slider_6 = Slider(0.7, range=0..1)
number_slider_7 = Slider(50, range=0..100)
brep_3 = Brep(center_box_2)
brep_4 = Brep(center_box)
vector_xyz = VectorXYZ(XComponent=0, YComponent=0, ZComponent="-50000")  # -> Vector, Length
_3d_boundary_region = _3DBoundaryRegion(Boundary=brep, IsVoid=False)
number_slider_8 = Slider(10, range=0..10)
field_value = FieldValue(Field=physarealm.ChemoAttractorField)  # disabled
population_position = PopulationPosition(Population=physarealm.Population)
panel = Panel(physarealm.Population)
panel_2 = Panel(physarealm.Iteration)
construct_point = ConstructPoint(XCoordinate=number_slider_7, YCoordinate=number_slider_7, ZCoordinate=number_slider_7)
_3d_support_region = _3DSupportRegion(Boundary=brep_3, SupportType=63, AmendExistingSupports=True)
population_interconnect = PopulationInterconnect(
    Population=physarealm.Population,
    Environment=physarealm.ChemoAttractorField,
    DetectRadius=number_slider_5,
    SelectPossibility=number_slider_6)
curve = Curve(<curve referenced from the Rhino model>)
field_interconnect = FieldInterconnect(
    Field=physarealm.ChemoAttractorField,
    Radius=number_slider_5,
    Possibility=number_slider_6,
    NearLevel=Slider(0.99, range=0..1))  # -> ConnectLine, ConnectWeight; disabled
bounds = Bounds(Numbers=field_value)
_3d_load_region = _3DLoadRegion(Boundary=brep_4, Load=vector_xyz.Vector)
cloud_display_2 = CloudDisplay(Points=population_position, Colours=ColourSwatch(SwatchColor=RGBA(255, 255, 255, 145)), Size=1, SpriteType=0)
length = Length(Curve=population_interconnect)
remap_numbers = RemapNumbers(Value=field_value, Source=bounds, Target=Domain(0, 1))  # -> Mapped, Clipped
bounds_2 = Bounds(Numbers=length)
population_trail = PopulationTrail(Population=physarealm.Population, HistoryStep=10, Reset=Toggle(False))
colour_swatch = ColourSwatch(SwatchColor=RGBA(255, 255, 255, 114))
curve_2 = Curve(population_interconnect)
topostruct_3d_model = Topostruct3DModel(ModelComponents=[_3d_boundary_region, _3d_load_region, _3d_support_region], XResolution=number_slider)  # -> FEModel, CellCentres, CellSize
deconstruct_domain = DeconstructDomain(Domain=bounds_2)  # -> Start, End
timer_2 = Timer(TimerInterval=20, Target=c_script)  # disabled
polyline = PolyLine(Vertices=population_trail, Closed=False)
iso_surface = IsoSurface(
    Box=brep,
    Values=field_value,
    XResolution=number_slider,
    YResolution=number_slider,
    ZResolution=number_slider,
    IsoValue=Slider(0.51, range=0.1..1),
    MergeVertices=True)  # disabled
explode = Explode(Curve=polyline, Recursive=True)  # -> Segments, Vertices
c_script = CSharpScript(reset=Toggle(False))  # -> out, A; inputs reset: Boolean
# ---------- c_script: C# ----------
if(reset)
      count = 0;
    A = count;
    count++;
# ---------- c_script: C# additional code ----------
  int count = 0;
# ---------- end c_script ----------
python_script = PythonScript(Target=construct_point, crvFrom=curve, numbers=c_script.A)  # -> out, a; inputs Target: Point3d, crvFrom: Curve, numbers: Int32
# ---------- python_script: Python ----------
import rhinoscriptsyntax as rs
import Rhino.Display as rd
import scriptcontext as sc

FromList = rs.DivideCurve(crvFrom, 100)
rs.ViewCameraUp("Perspective", [0,0,1])
#rs.ViewCameraTarget("Perspective", FromList[numbers], TargetList[numbers])
#rs.ViewDisplayMode("Perspective", "Wireframe")
rs.ViewDisplayMode("Perspective")
numbers = numbers % 100
rd.RhinoViewport.SetCameraLocations(sc.doc.Views.ActiveView.ActiveViewport, Target, FromList[numbers])
# ---------- end python_script ----------
gradient = Gradient(
    LowerLimit=deconstruct_domain.Start,
    UpperLimit=deconstruct_domain.End,
    Parameter=length,
    stops=[0: RGB(255, 255, 255), 1: RGB(0, 0, 0)])
c_script_2 = CSharpScript(Reference="D:\研\上\STUDIO\1024SLIMEMOLDALGOINRHINO\PHYSARUMTEST-RHINO\PhysarumLib.dll")  # -> out, eva_mesh, trail, connect_lines; inputs particle_pos: list of Point3d, analysis_z: Int32, trail_out: Boolean
# ---------- c_script_2: C# ----------
    Grid3d mygrid = Grid as Grid3d;
    List<Line> connect = new List<Line>();
    //Mesh evaMesh = new Mesh();
    foreach(Point3d pt in particle_pos)
    {
      List<Point3d> nei = mygrid.findNeighborParticle((int) pt.X, (int) pt.Y, (int) pt.Z, 2);
      foreach(Point3d pt_nei in nei)
      {
        connect.Add(new Line(pt_nei, pt));
      }
    }

    //evaMesh = mygrid.getTrailEvaMesh(analysis_z);
    //eva_mesh = evaMesh;
    if(trail_out)
      trail = mygrid.getTrailV();
    connect_lines = connect;
# ---------- end c_script_2 ----------
mesh_flip = MeshFlip(Mesh=iso_surface)
custom_preview = CustomPreview(Geometry=curve_2, Shader=gradient)  # disabled
sort_list = SortList(Keys=length)  # -> Keys, ValuesA
number_slider_9 = Slider(100, range=0..100)
list_length = ListLength(List=flatten(explode.Segments))
list_length_2 = ListLength(List=explode.Segments)
topostruct_3d_solver = Topostruct3DSolver(
    FEModel=topostruct_3d_model.FEModel,
    SelfWeightCoefficient=0,
    OptimisationIterations=1,
    Smoothing=0.1,
    Penalization=3,
    TargetDensity=0.6,
    InitialDensities=remap_numbers.Mapped,
    MinimumDensity=0.001,
    DeleteThreshold=0.5,
    PeriodicX=False,
    PeriodicY=False,
    PeriodicZ=False,
    LoadCase=0,
    AllCases=True)  # -> FEModel, MaxDeflection; disabled

# ---- group: Capture View
c_script_3 = CSharpScript(
    x=Slider(2000, range=0..10000),
    y=Slider(2000, range=0..10000),
    count=list_length,
    folder_path="C:\\Users\\Yidong\\Desktop\\test\\",
    start=Toggle(False))  # -> out, A; inputs x: Int32, y: Int32, count: Int32, folder_path: String, start: Boolean
# ---------- c_script_3: C# ----------
    //Rhino.Display.RhinoView thisView = new Rhino.Display.RhinoView();
    if(start == false)
    {
      countPrv = 0;
      t = 0;
    }
    if(count != countPrv && start == true)
    {
      t++;
      System.Threading.Thread.Sleep(50);
      Size mySize = new Size(x, y);
      Bitmap view = doc.Views.ActiveView.CaptureToBitmap(mySize, false, false, false);
      //Bitmap view = doc.Views.ActiveView.CaptureToBitmap(mySize);
      String filename = folder_path + t.ToString() + ".png";
      view.Save(filename);
      countPrv = count;
    }
# ---------- c_script_3: C# additional code ----------
  int t = 0;
  int countPrv = 0;
# ---------- end c_script_3 ----------

c_script_4 = CSharpScript(
    x=Slider(2000, range=0..10000),
    y=Slider(2000, range=0..10000),
    count=c_script.A,
    folder_path="C:\\Users\\Yidong\\Desktop\\test\\",
    start=Toggle(True))  # -> out, A; inputs x: Int32, y: Int32, count: Int32, folder_path: String, start: Boolean
# ---------- c_script_4: C# ----------
    //Rhino.Display.RhinoView thisView = new Rhino.Display.RhinoView();
    int countPrv = 0;
    if(count != countPrv && start == true)
    {
      System.Threading.Thread.Sleep(200);
      Size mySize = new Size(x, y);
      Bitmap view = doc.Views.ActiveView.CaptureToBitmap(mySize, false, false, false);
      //Bitmap view = doc.Views.ActiveView.CaptureToBitmap(mySize);
      String filename = folder_path + count.ToString() + ".png";
      view.Save(filename);
      countPrv = count;
    }
# ---------- end c_script_4 ----------

# ----
panel_3 = Panel(list_length)
series = Series(Start=0, Step=1, Count=list_length_2)
bounds_3 = Bounds(Numbers=flatten(series))
multiplication = Multiplication(A=topostruct_3d_solver.MaxDeflection, B=Slider(236, range=0..1000))
_3d_cell_results = _3DCellResults(FEModel=topostruct_3d_solver.FEModel)  # -> PrincipalStressPlanes, PrincipalStresses, VonMisesStress, Density
deconstruct_domain_2 = DeconstructDomain(Domain=bounds_3)  # -> Start, End
_3d_iso_mesh = _3DIsoMesh(FEModel=topostruct_3d_solver.FEModel, Deflection=0, IsoContourValue=multiplication, ColorMode=4)
number = Number([0.001, 0.001, 0.001, 0.001, 0.001, 0.001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])
gradient_2 = Gradient(
    LowerLimit=deconstruct_domain_2.Start,
    UpperLimit=deconstruct_domain_2.End,
    Parameter=series,
    stops=[0: RGB(255, 255, 255), 1: RGB(0, 0, 0)])
mesh_unifynormals = MeshUnifyNormals(Mesh=_3d_iso_mesh)
graph_mapper = GraphMapper(_3d_cell_results.Density, x0=0, x1=1, y0=0, y1=1, container_name="Conic", Cx=0.7227712274, Cy=0.3485171795)
custom_preview_2 = CustomPreview(Geometry=explode.Segments, Shader=reverse(gradient_2))
mesh_flip_2 = MeshFlip(Mesh=mesh_unifynormals)
c_script_5 = CSharpScript(x=Slider(50, range=0..100), nums=_3d_cell_results.Density, pts=topostruct_3d_model.CellCentres)  # -> out, lines, weights; inputs x: Int32, nums: list of Double, pts: list of Point3d
# ---------- c_script_5: C# ----------
    int count = 0;
    List<Line> retLine = new List<Line>();
    List<double> weight = new List<double>();
    for(int k = 0; k < x; k++){
      for(int j = 0; j < x; j++)
      {
        for(int i = 0; i < x; i++){
          param[i, j, k] = nums[count];
          count++;
        }
      }
    }

    for(int k = 0; k < x; k++){
      for(int j = 0; j < x; j++)
      {
        for(int i = 0; i < x; i++){
          if(rd.NextDouble() > param[i, j, k] )
            continue;
          Point3d thispt = new Point3d(i, j, k);
          List<Point3d> neighbor = findNeighborParticle(i, j, k, 1, 0.0001);
          foreach(Point3d pt in neighbor){
            if(rd.NextDouble() < param[i, j, k] * 2){
              retLine.Add(new Line(pt, thispt));
              weight.Add(param[i, j, k] + param[(int) pt.X, (int) pt.Y, (int) pt.Z]);
            }
          }
        }
      }
    }
    lines = retLine;
    weights = weight;
# ---------- c_script_5: C# additional code ----------
  double[,,] param = new double[50, 50, 50];
  int _x = 50;
  int _y = 50;
  int _z = 50;
  Random rd = new Random();

  public List<Point3d> findNeighborParticle(int x, int y, int z, int radius, double near_level)
  {
    List<Point3d> nei = new List<Point3d>();
    int start_x = x - radius > 0 ? x - radius : 0;
    int start_y = y - radius > 0 ? y - radius : 0;
    int start_z = z - radius > 0 ? z - radius : 0;
    int end_x = x + radius <= _x - 1 ? x + radius : _x - 1;
    int end_y = y + radius <= _y - 1 ? y + radius : _y - 1;
    int end_z = z + radius <= _z - 1 ? z + radius : _z - 1;
    for (int i = start_x; i <= end_x; i++)
    {
      for (int j = start_y; j <= end_y; j++)
      {
        for (int k = start_z; k <= end_z; k++)
        {
          if (param[i, j, k] - param[x, y, z] < near_level)
            nei.Add(new Point3d(i, j, k));
        }
      }
    }

    return nei;
  }
# ---------- end c_script_5 ----------
graph_mapper_2 = GraphMapper(c_script_5.weights, x0=0, x1=1, y0=0, y1=1, container_name="Conic", Cx=0.3315217495, Cy=0.7133152485)
colour_rgb_f = ColourRGBF(Alpha=graph_mapper, Red=0, Green=255, Blue=0)
mesh = Mesh(mesh_flip_2)
cloud_display_3 = CloudDisplay(Points=topostruct_3d_model.CellCentres, Colours=colour_rgb_f, Size=1, SpriteType=0)
panel_4 = Panel(c_script_5.out)
scale = Scale(Geometry=c_script_5.lines, Center=Point(0, 0, 0), Factor=2)  # -> Geometry, Transform
graphfromlines = GraphFromLines(ConnectionLines=scale.Geometry, undirected=True)  # -> Graph, GraphPoints
breadth_first_search = BreadthFirstSearch(Graph=graphfromlines.Graph, StartPoints=Slider(957, range=0..1000), methode=0)  # -> PreviouseGraph, Cost
display_graph = DisplayGraph(Graph=breadth_first_search.PreviouseGraph, GraphPoints=graphfromlines.GraphPoints, hidden=True)  # -> VertexCount, EdgeCount, Edge
series_2 = Series(Start=0, Step=1, Count=display_graph.EdgeCount)
display_graphedge = DisplayGraphEdge(
    Graph=graphfromlines.Graph,
    GraphPoints=graphfromlines.GraphPoints,
    GraphEdgeIndex=graft(series_2),
    Value=graph_mapper_2,
    hidden=True,
    show=0)  # -> A, B, Cost, Edge; disabled
line = Line(display_graphedge.Edge)
line_2 = Line(display_graph.Edge)
c_script_6 = CSharpScript(lines=line_2, weights=_3d_cell_results.Density)  # -> out, A; inputs lines: list of Line, weights: list of Double
# ---------- c_script_6: C# ----------
    int count = 0;
    List<double> weis = new List<Double>();
    for(int k = 0; k < 50; k++){
      for(int j = 0; j < 50; j++)
      {
        for(int i = 0; i < 50; i++){
          param[i, j, k] = weights[count];
          count++;
        }
      }
    }
    foreach(Line l in lines)
    {
      Point3d midpt = l.PointAt(0.5);
      double val = param[(int)midpt.X / 2, (int)midpt.Y / 2,(int) midpt.Z / 2];
      weis.Add(val);
    }
    A = weis;
# ---------- c_script_6: C# additional code ----------
  double[,,] param = new double[50, 50, 50];
# ---------- end c_script_6 ----------
sort_list_2 = SortList(Keys=c_script_6.A)  # -> Keys, ValuesA
graph_mapper_3 = GraphMapper(c_script_6.A, x0=0, x1=1, y0=0, y1=1, container_name="Conic", Cx=0.3333333433, Cy=0.7565214634)
gradient_3 = Gradient(LowerLimit=1, UpperLimit=0, Parameter=graph_mapper_3, stops=[0: RGB(255, 255, 255), 1: RGB(0, 0, 0)])
custom_preview_3 = CustomPreview(Geometry=line_2, Shader=gradient_3)
