# Grasshopper definition testBrepEnvi.gh (Grasshopper 0.9.76)
# plug-ins: Physarealm, Millipede

number_slider = Slider(40, range=0..100)
speed_setting = SpeedSetting(MaxSpeed=Slider(5, range=0..10))
point = Point([<point referenced from the Rhino model> x5])
brep = Brep(<brep referenced from the Rhino model>)
point_2 = Point([<point referenced from the Rhino model> x2])
brep_2 = Brep(<brep referenced from the Rhino model>)
trail_setting = TrailSetting(AgentFoodTrailRatio=Slider(0.5, range=0..1))
number_slider_2 = Slider(10, range=0..10)
number_slider_3 = Slider(5, range=0..10)
number_slider_4 = Slider(10, range=0..10)
initial_population_setting = InitialPopulationSetting(PopulationSize=200)
brep_environment = BrepEnvironment(XResolution=number_slider, YResolution=number_slider, ZResolution=number_slider, Brep=brep)  # -> Environment, Pts
point_emitter = PointEmitter(Points=point_2)
points_food = PointsFood(Points=point)
timer = Timer(TimerInterval=50, Target=physarealm)  # disabled
point_3 = Point([<point referenced from the Rhino model> x3])
center_box = CenterBox(Base=point_2, X=number_slider_4, Y=number_slider_4, Z=number_slider_3)
center_box_2 = CenterBox(Base=point_3, X=number_slider_2, Y=number_slider_2, Z=number_slider_3)
physarealm = Physarealm(
    Environment=brep_environment.Environment,
    Emitter=point_emitter,
    Food=points_food,
    Settings=[initial_population_setting, trail_setting, speed_setting],
    Reset=Toggle(False))  # -> ChemoAttractorField, Population, Iteration
number_slider_5 = Slider(0.8, range=0..1)
number_slider_6 = Slider(1, range=0..10)
brep_3 = Brep(center_box_2)
brep_4 = Brep(center_box)
vector_xyz = VectorXYZ(XComponent=0, YComponent=0, ZComponent="-50000")  # -> Vector, Length
_3d_boundary_region = _3DBoundaryRegion(Boundary=brep, IsVoid=False)
field_value = FieldValue(Field=physarealm.ChemoAttractorField)
population_position = PopulationPosition(Population=physarealm.Population)
panel = Panel(physarealm.Population)
panel_2 = Panel(physarealm.Iteration)
_3d_support_region = _3DSupportRegion(Boundary=brep_3, SupportType=63, AmendExistingSupports=True)
population_interconnect = PopulationInterconnect(
    Population=physarealm.Population,
    Environment=physarealm.ChemoAttractorField,
    DetectRadius=number_slider_6,
    SelectPossibility=number_slider_5)  # disabled
field_interconnect = FieldInterconnect(
    Field=physarealm.ChemoAttractorField,
    Radius=number_slider_6,
    Possibility=number_slider_5,
    NearLevel=Slider(0.99, range=0..1))  # -> ConnectLine, ConnectWeight; disabled
bounds = Bounds(Numbers=field_value)
_3d_load_region = _3DLoadRegion(Boundary=brep_4, Load=vector_xyz.Vector)
c_script = CSharpScript(Reference="D:\研\上\STUDIO\1024SLIMEMOLDALGOINRHINO\PHYSARUMTEST-RHINO\PhysarumLib.dll")  # -> out, eva_mesh, trail, connect_lines; inputs particle_pos: list of Point3d, analysis_z: Int32, trail_out: Boolean
# ---------- c_script: C# ----------
    Grid3d mygrid = Grid as Grid3d;
    List<Line> connect = new List<Line>();
    //Mesh evaMesh = new Mesh();
    foreach(Point3d pt in particle_pos)
    {
      List<Point3d> nei = mygrid.findNeighborParticle((int) pt.X, (int) pt.Y, (int) pt.Z, 2);
      foreach(Point3d pt_nei in nei)
      {
        connect.Add(new Line(pt_nei, pt));
      }
    }

    //evaMesh = mygrid.getTrailEvaMesh(analysis_z);
    //eva_mesh = evaMesh;
    if(trail_out)
      trail = mygrid.getTrailV();
    connect_lines = connect;
# ---------- end c_script ----------
remap_numbers = RemapNumbers(Value=field_value, Source=bounds, Target=Domain(0, 1))  # -> Mapped, Clipped
topostruct_3d_model = Topostruct3DModel(ModelComponents=[_3d_boundary_region, _3d_load_region, _3d_support_region], XResolution=number_slider)  # -> FEModel, CellCentres, CellSize
topostruct_3d_solver = Topostruct3DSolver(
    FEModel=topostruct_3d_model.FEModel,
    SelfWeightCoefficient=0,
    OptimisationIterations=1,
    Smoothing=0.1,
    Penalization=3,
    TargetDensity=0.4,
    InitialDensities=remap_numbers.Mapped,
    MinimumDensity=0.001,
    DeleteThreshold=0.5,
    PeriodicX=False,
    PeriodicY=False,
    PeriodicZ=False,
    LoadCase=0,
    AllCases=True)  # -> FEModel, MaxDeflection; disabled
_3d_cell_results = _3DCellResults(FEModel=topostruct_3d_solver.FEModel)  # -> PrincipalStressPlanes, PrincipalStresses, VonMisesStress, Density
c_script_2 = CSharpScript(nums=_3d_cell_results.Density)  # -> out, lines, weights; inputs nums: list of Double
# ---------- c_script_2: C# ----------
    int count = 0;
    List<Line> retLine = new List<Line>();
    List<double> weight = new List<double>();
    for(int k = 0; k < 40; k++){
      for(int j = 0; j < 40; j++)
      {
        for(int i = 0; i < 40; i++){
          param[i, j, k] = nums[count];
          count++;
        }
      }
    }

    for(int k = 0; k < 40; k++){
      for(int j = 0; j < 40; j++)
      {
        for(int i = 0; i < 40; i++){
          if(rd.NextDouble() > param[i, j, k] )
            continue;
          Point3d thispt = new Point3d(i, j, k);
          List<Point3d> neighbor = findNeighborParticle(i, j, k, 1, 0.0002);
          foreach(Point3d pt in neighbor){
            if(rd.NextDouble() < param[i, j, k]  * 0.8){
              retLine.Add(new Line(pt, thispt));
              weight.Add(param[i, j, k] + param[(int) pt.X, (int) pt.Y, (int) pt.Z]);
            }
          }
        }
      }
    }
    lines = retLine;
    weights = weight;
# ---------- c_script_2: C# additional code ----------
  double[,,] param = new double[40, 40, 40];
  int _x = 40;
  int _y = 40;
  int _z = 40;
  Random rd = new Random();

  public List<Point3d> findNeighborParticle(int x, int y, int z, int radius, double near_level)
  {
    List<Point3d> nei = new List<Point3d>();
    int start_x = x - radius > 0 ? x - radius : 0;
    int start_y = y - radius > 0 ? y - radius : 0;
    int start_z = z - radius > 0 ? z - radius : 0;
    int end_x = x + radius <= _x - 1 ? x + radius : _x - 1;
    int end_y = y + radius <= _y - 1 ? y + radius : _y - 1;
    int end_z = z + radius <= _z - 1 ? z + radius : _z - 1;
    for (int i = start_x; i <= end_x; i++)
    {
      for (int j = start_y; j <= end_y; j++)
      {
        for (int k = start_z; k <= end_z; k++)
        {
          if (param[i, j, k] - param[x, y, z] < near_level)
            nei.Add(new Point3d(i, j, k));
        }
      }
    }

    return nei;
  }
# ---------- end c_script_2 ----------
line = Line(c_script_2.lines)
